test file "test"
  coverage: Decision, MCDC, RelationalBoundary, Condition

suite "Mode_Logic"

  case "Mode_Logic_Harness1" [simulation]
    model Mode_Logic, harness Mode_Logic_Harness1

  case "Mode_Logic_Harness2" [baseline]
    model Mode_Logic, harness Mode_Logic_Harness2
    input "TestPattern1" from ModelLogic_TestScenario.xlsx, mapped to Speed -> speed, Brake -> brake, Charge -> charge, EngSpeed -> engine_speed (active)
    input "TestPattern2" from ModelLogic_TestScenario.xlsx, mapped to Speed -> speed, Brake -> brake, Charge -> charge, EngSpeed -> engine_speed
    baseline "TestPattern1"
      Mot_Enable
      Gen_Enable
      ICE_Enable
    baseline "TestPattern2"
      Mot_Enable
      Gen_Enable
      ICE_Enable
    iterations:
      Iteration1: ExternalInput "TestPattern1", Baseline "TestPattern1"
      Iteration2: ExternalInput "TestPattern2", Baseline "TestPattern2"